vi "Main.gvi"   [LabVIEW NXG 3.1.0]
# This template is for the Queued Message Handler design pattern.
# The Event Handling Loop generates messages based on user interface actions.
# The Message Handling Loop processes messages generated by the Event Handling Loop, or by other messages.  The messages are string values, so new messages can be added easily to the Message Cases case structure in the Message Handling Loop.  Each message cluster can also provide an optional value for Message Data, which is a variant that can be converted to whatever message-specific data is required.
panel controls:
  "Exit": bool
  "Do Something <Replace Me>": bool
  "Do Something Else <Replace Me>": bool
panel indicators:
  "Display <Replace Me>": string
types:
  "UI Data.gtype" = cluster{"Boolean <Replace Me>": bool, "String <Replace Me>": string, "Numeric <Replace Me>": f64}
uses:
  NI::G Core::Error::Display Error.gvi
  NI::G Core::Error::Build Error Cluster.gvi
diagram:
  w1 = bool FALSE  # Stop Event
  Create User Event[EventName="Stop Event"](user event data type=w1) -> (error out=w2, user event out=w3)
  call "Create All Message Queues.gvi"(error in=w2) -> (message queues=w4, error out=w5)
  # This shift register stores the data for the message handler
  Property Node(instance in=w4) -> ("UI"=w6)
  # This is the Queued Message Handler design pattern. The Event Handling Loop generates messages based on user interface actions. The Message Handling Loop processes messages generated by the Event Handling Loop, or by other messages.  The messages are string values, so new messages can be added easily to the Message Cases case structure in the Message Handling Loop.  Each message cluster can also provide an optional value for Message Data, which is a variant that can be converted to whatever message-specific data is required.
  s1 = "UI Data.gtype" {all zero or empty}  # shift register
  while {
    call "Dequeue Message.gvi"(message queue in=w6, error in=w5) -> (message queue out=w7, message=w8, message data=w9, error out=w10)
    # s1: Data
    # w3: Stop Event
    case (w8) ignore case {  # Message Cases
      frame "Initialize" {
        # Bundle a sample string value.
        Property Node(instance in=s1, "String <Replace Me>"="Initial Message") -> (instance out=w12)
        call "Enqueue Message (Single).gvi"(message queue in=w7, message="Update Display", message data="Initial Message", error in=w10) -> (error out=w11)
        w13 = default
      }
      frame "Something" {
        # #CodeNeeded - Perform whatever actions correspond to the "Something" message.
        # Send string to "Update Display" message
        call "Enqueue Message (Single).gvi"(message queue in=w7, message="Update Display", message data="\"Do Something\" button pressed", error in=w10) -> (error out=w11)
        w12 = s1
        w13 = default
      }
      frame "Something Else" {
        # #CodeNeeded - Perform whatever actions correspond to the "Something Else" message.
        # Send string to "Update Display" message
        call "Enqueue Message (Single).gvi"(message queue in=w7, message="Update Display", message data="\"Do Something Else\" button pressed", error in=w10) -> (error out=w11)
        w12 = s1
        w13 = default
      }
      frame "Update Display" {
        # #CodeRecommended - If you wish to decouple the Message Handling Loop from your user interface, consider creating User Events (like the "Stop" event in this VI) to message the Event Handling Loop whenever the user interface needs updating.
        Variant To Data(error in (no error)=w10, type=string "", variant=w9) -> (data=w14, error out=w11)
        $"Display <Replace Me>" <- w14
        w12 = s1
        w13 = default
      }
      frame "Error" {
        Variant To Data(error in (no error)=w10, type=no error, variant=w9) -> (data=w15, error out=w11)
        # #CodeRecommended - Consider creating a system for logging errors in some way. These errors are for notification purposes only. Handling of specific errors should be performed in the message frames that generated the error.
        # #CodeRecommended - If you ever change the name of this "Error" message, you'll need to update the name in the Check Loop Error.vi as well.
        call "Display Error.gvi"(error in=w15)
        w12 = s1
        w13 = default
      }
      frame "---Copy This Frame---" {
        Merge Errors(w10) -> (error out=w11)
        w12 = s1
        w13 = default
      }
      frame "Exit" {
        # Release the message queue reference
        Release Queue(error in=w10, queue=w7) -> (error out=w16)
        # #CodeNeeded - Add any required cleanup code here. Note that if 'Exit' was called as a result of an error, an error dialog will be displayed. Add any custom error handling for an 'Exit' condition here as well.
        Generate User Event(event data=TRUE, user event=w3) -> (error out=w17)
        Merge Errors(w17, w16) -> (error out=w11)
        # Stop the VI
        w12 = s1
        w13 = TRUE
      }
      frame Default {
        w18 = "The invalid message string \"%s\" was received in the Message Handling Loop."
        Format Into String(formatString=w18, w8) -> w19
        call "Build Error Cluster.gvi"(code=1, description=w19) -> (error out=w11)
        w12 = s1
        w13 = default
      }
    }
    call "Error Handler - Message Handling Loop.gvi"(message queue in=w7, error in=w11) -> (dup error in=w20)
    next s1 = w12
    stop if w13
  }
  Register For Events("Stop Event"=w3) -> (event registration refnum out=w21)
  s2 = w21  # shift register
  while {
    event (dynamic events = s2) {
      on "Do Something <Replace Me>" Value changed {
        # #CodeNeeded - Send the appropriate message for this user interface event.
        call "Enqueue Message (Single).gvi"(message queue in=w6, message="Something") -> (message queue out=w24, error out=w23)
        w22 = default
      }
      on "Do Something Else <Replace Me>" Value changed {
        # #CodeNeeded - Send the appropriate message for this user interface event.
        call "Enqueue Message (Single).gvi"(message queue in=w6, message="Something Else") -> (message queue out=w24, error out=w23)
        w22 = default
      }
      on "Exit" Value changed {
        call "Enqueue Message (Single).gvi"(message queue in=w6, message="Exit", priority message=TRUE) -> (message queue out=w24, error out=w23)
        w22 = default
      }
      on "Dynamic" Stop Event {
        # The Message Handling Loop processed an "Exit" message, which fired this event to stop the Event Handling Loop.
        $"Display <Replace Me>" <- "\"Exit\" button pressed"
        w22 = TRUE
        w23 = default
        w24 = w6
      }
      on "Window" Close? {
        Event Filter("Discard?"=TRUE)
        w22 = default
        w23 = default
        w24 = w6
      }
    }
    call "Error Handler - Event Handling Loop.gvi"(message queue in=w24, error in=w23) -> (dup error in=w25)
    stop if w22
  }
  Unregister For Events(error in=w25, event registration refnum=s2) -> (error out=w26)
  Merge Errors(w26, w20) -> (error out=w27)
  Destroy User Event(error in=w27, user event=w3)
